# Grasshopper definition Facade.gh (Grasshopper 1.0.7)

# ---- group: Initial Geometric Variables
number_slider = Slider(30, range=0..100)
number_slider_2 = Slider(2.9, range=0..10)
number_slider_3 = Slider(3.75, range=0..10)
number_slider_4 = Slider(2, range=0..10)
number_slider_5 = Slider(4, range=0..10)
number_slider_6 = Slider(13.5, range=0..20)

# ---- group: Geometry Setup
polygon = Polygon(Plane=PlaneXY(0, 0, 0), Radius=number_slider_6, Segments=number_slider, FilletRadius=0)  # -> Polygon, Length
division = Division(A=number_slider_3, B=number_slider_4)
boundary = BoundarySurfaces(Edges=polygon.Polygon)
explode = Explode(Curve=polygon.Polygon, Recursive=True)  # -> Segments, Vertices
crv = Curve(explode.Segments)
dispatch = Dispatch(List=crv, DispatchPattern=[True, False])  # -> ListA, ListB

crv_2 = Curve(dispatch.ListA)
Z = UnitZ(Factor=number_slider_2)
Z_2 = UnitZ(Factor=number_slider_3)
Z_3 = UnitZ(Factor=division)
number_slider_7 = Slider(1, range=0..2)
number_slider_8 = Slider(2, range=0..2)
crv_3 = Curve(dispatch.ListB)
extr = Extrude(Base=crv_2, Direction=Z_2)
extr_2 = Extrude(Base=crv_3, Direction=Z_2)
move = Move(Geometry=boundary, Motion=Z_2)  # -> Geometry, Transform
move_2 = Move(Geometry=crv_2, Motion=Z)  # -> Geometry, Transform
move_3 = Move(Geometry=crv_3, Motion=Z_3)  # -> Geometry, Transform
item = ListItem(List=extr, Index=0, Wrap=True)
item_2 = ListItem(List=extr_2, Index=0, Wrap=True)
divide = DivideDomain²(Domain=item, UCount=number_slider_7, VCount=number_slider_8)  # -> graft(Segments)
divide_2 = DivideDomain²(Domain=item_2, UCount=number_slider_7, VCount=number_slider_8)  # -> graft(Segments)
number_slider_9 = Slider(15, range=0..100)
subsrf = Isotrim(Surface=extr, Domain=divide)  # -> flatten(Surface)
subsrf_2 = Isotrim(Surface=extr_2, Domain=divide_2)  # -> flatten(Surface)
partition = PartitionList(List=subsrf, Size=number_slider_9)
partition_2 = PartitionList(List=subsrf_2, Size=number_slider_9)
bang = ExplodeTree(Data=partition)  # -> Branch0, Branch1
bang_2 = ExplodeTree(Data=partition_2)  # -> Branch0, Branch1

explode_2 = Explode(Curve=polygon.Polygon, Recursive=True)  # -> Segments, Vertices
cir = Circle(Plane=PlaneXY(0, 0, 0), Radius=number_slider_5)
area = Area(Geometry=cir)  # -> Area, Centroid
dispatch_2 = Dispatch(List=explode_2.Vertices, DispatchPattern=[True, False])  # -> ListA, ListB
pt = Point(dispatch_2.ListA)
ln = Line(StartPoint=area.Centroid, EndPoint=pt)
ccx = CurveCurve(CurveA=cir, CurveB=ln)  # -> Points, ParamsA, ParamsB
pt_2 = Point(flatten(ccx.Points))
ln_2 = Line(StartPoint=pt_2, EndPoint=pt)
crv_4 = Curve([cir, ln_2])
extr_3 = Extrude(Base=crv_4, Direction=Z_2)

srf = Surface(bang.Branch0)
srf_2 = Surface(bang.Branch1)
srf_3 = Surface(bang_2.Branch1)
srf_4 = Surface(bang_2.Branch0)
srfsplit = SurfaceSplit(Surface=srf_2, Curves=move_2.Geometry)  # -> flatten(Fragments)
srfsplit_2 = SurfaceSplit(Surface=srf_4, Curves=move_3.Geometry)  # -> flatten(Fragments)
srfsplit_3 = SurfaceSplit(Surface=srf_3, Curves=move_3.Geometry)  # -> flatten(Fragments)
dispatch_3 = Dispatch(List=srfsplit, DispatchPattern=[True, False])  # -> ListA, ListB
dispatch_4 = Dispatch(List=srfsplit_2, DispatchPattern=[True, False])  # -> ListA, ListB
dispatch_5 = Dispatch(List=srfsplit_3, DispatchPattern=[True, False])  # -> ListA, ListB

srf_5 = Surface(dispatch_3.ListA)
srf_6 = Surface(dispatch_3.ListB)
srf_7 = Surface(dispatch_4.ListA)
srf_8 = Surface(dispatch_4.ListB)
srf_9 = Surface(dispatch_5.ListA)
srf_10 = Surface(dispatch_5.ListB)

# ----
cluster = Cluster()  # -> mat, mat_2, mat_3, mat_4, mat_5, mat_6, mat_7, mat_8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
merge = Merge(
    Data1=cluster.mat,
    Data2=cluster.mat_2,
    Data3=cluster.mat_3,
    Data4=cluster.mat_4,
    Data5=cluster.mat_5,
    Data6=cluster.mat_6,
    Data7=cluster.mat_7,
    Data8=cluster.mat_8,
    Data9=cluster.mat_9,
    Data10=cluster.mat_10,
    Data11=cluster.mat_11,
    Data12=cluster.mat_12)
item_3 = ListItem(List=merge, Index=0, Wrap=True)

searchconstrs = HBSearchConstructions(keywords="window")  # -> opaque_constrs, window_constrs, shade_constrs; plug-in component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
item_4 = ListItem(List=searchconstrs.window_constrs, Index=Slider(37, range=0..100), Wrap=True)
windowconstrshd = HBWindowConstructionShade(win_constr=item_4, shd_material=item_3, shd_location="Exterior", control_type="1", setpoint="150")  # -> constr; plug-in component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

genes = GenePool(Decimals=1, Maximum=1, Minimum=0, Value=[0, 0, 0, 0, 0, 0, 0, 0, 0, 0, 0, 0, 0, 0, 0, 0, 0, 0, 0, 0, 0, 0, 0, 0])
genes_2 = GenePool(Decimals=1, Maximum=1, Minimum=0, Value=[0, 0, 0, 0, 0, 0, 0.5, 0.5, 1, 1, 1, 1, 1, 1, 1, 1, 1, 1, 1, 0.5, 0.5, 0, 0, 0])
weeklyschedule = HBWeeklySchedule(
    sun=genes,
    mon=genes_2,
    tue=genes_2,
    wed=genes_2,
    thu=genes_2,
    fri=genes_2,
    sat=genes,
    holiday=genes,
    name="Occ",
    type_limit="Fractional")  # -> report, schedule, idf_year, idf_week, idf_days; plug-in component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

genes_3 = GenePool(
    Decimals=0,
    Maximum=32,
    Minimum=0,
    Value=[22, 22, 22, 22, 22, 22, 22, 22, 22, 22, 22, 22, 22, 22, 22, 22, 22, 22, 22, 22, 22, 22, 22, 22])

genes_4 = GenePool(
    Decimals=0,
    Maximum=32,
    Minimum=0,
    Value=[22, 22, 22, 22, 22, 22, 24, 24, 25, 25, 25, 25, 25, 25, 25, 25, 25, 25, 25, 24, 24, 22, 22, 22])
genes_5 = GenePool(
    Decimals=0,
    Maximum=32,
    Minimum=0,
    Value=[15, 15, 15, 15, 15, 15, 15, 15, 21, 21, 21, 21, 21, 21, 21, 21, 21, 21, 21, 15, 15, 15, 15, 15])
genes_6 = GenePool(
    Decimals=0,
    Maximum=32,
    Minimum=0,
    Value=[15, 15, 15, 15, 15, 15, 15, 15, 15, 15, 15, 15, 15, 15, 15, 15, 15, 15, 15, 15, 15, 15, 15, 15])
weeklyschedule_2 = HBWeeklySchedule(
    sun=genes_6,
    mon=genes_5,
    tue=genes_5,
    wed=genes_5,
    thu=genes_5,
    fri=genes_5,
    sat=genes_6,
    holiday=genes_6,
    name="Heating Setback",
    type_limit="Temperature")  # -> report, schedule, idf_year, idf_week, idf_days; plug-in component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
weeklyschedule_3 = HBWeeklySchedule(
    sun=genes_3,
    mon=genes_4,
    tue=genes_4,
    wed=genes_4,
    thu=genes_4,
    fri=genes_4,
    sat=genes_3,
    holiday=genes_3,
    name="Cooling Setback",
    type_limit="Temperature")  # -> report, schedule, idf_year, idf_week, idf_days; plug-in component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
setpoint = HBSetpoint(name="Mixed Mode", heating_sch=weeklyschedule_2.schedule, cooling_sch=weeklyschedule_3.schedule)  # -> setpoint; plug-in component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

debrep = DeconstructBrep(Brep=srf_5)  # -> Faces, Edges, Vertices
area_2 = Area(Geometry=srf_5)  # -> Area, Centroid
item_5 = ListItem(List=srf_5, Index=0, Wrap=True)
number_slider_10 = Slider(1, range=0..1)
item_6 = ListItem(List=debrep.Edges, Index=0, Wrap=True)  # -> flatten(Item), flatten(Item1)
debrep_2 = DeconstructBrep(Brep=item_5)  # -> Faces, Edges, Vertices
item_7 = ListItem(List=debrep_2.Edges, Index=0, Wrap=True)  # -> Item, Item1
multiplication = Multiplication(A=Slider(0.05, range=0..0.1), B=Slider(2, range=0..10))
pl = ConstructPlane(Origin=area_2.Centroid, XAxis=item_6.Item, YAxis=item_6.Item1)
len = Length(Curve=item_7.Item1)
len_2 = Length(Curve=item_7.Item)
division_2 = Division(A=multiplication, B=len_2)
division_3 = Division(A=multiplication, B=len)
subtraction = Subtraction(A=number_slider_10, B=division_2)
subtraction_2 = Subtraction(A=number_slider_10, B=division_3)
scale_nu = ScaleNU(Geometry=srf_5, Plane=pl, ScaleX=subtraction, ScaleY=subtraction_2, ScaleZ=1)  # -> Geometry, Transform

debrep_3 = DeconstructBrep(Brep=srf_8)  # -> Faces, Edges, Vertices
area_3 = Area(Geometry=srf_8)  # -> Area, Centroid
item_8 = ListItem(List=srf_8, Index=0, Wrap=True)
number_slider_11 = Slider(1, range=0..1)
item_9 = ListItem(List=debrep_3.Edges, Index=0, Wrap=True)  # -> flatten(Item), flatten(Item1)
debrep_4 = DeconstructBrep(Brep=item_8)  # -> Faces, Edges, Vertices
item_10 = ListItem(List=debrep_4.Edges, Index=0, Wrap=True)  # -> Item, Item1
multiplication_2 = Multiplication(A=Slider(0.05, range=0..0.1), B=Slider(2, range=0..10))
pl_2 = ConstructPlane(Origin=area_3.Centroid, XAxis=item_9.Item, YAxis=item_9.Item1)
len_3 = Length(Curve=item_10.Item1)
len_4 = Length(Curve=item_10.Item)
division_4 = Division(A=multiplication_2, B=len_4)
division_5 = Division(A=multiplication_2, B=len_3)
subtraction_3 = Subtraction(A=number_slider_11, B=division_4)
subtraction_4 = Subtraction(A=number_slider_11, B=division_5)
scale_nu_2 = ScaleNU(Geometry=srf_8, Plane=pl_2, ScaleX=subtraction_3, ScaleY=subtraction_4, ScaleZ=1)  # -> Geometry, Transform

debrep_5 = DeconstructBrep(Brep=srf_10)  # -> Faces, Edges, Vertices
area_4 = Area(Geometry=srf_10)  # -> Area, Centroid
item_11 = ListItem(List=srf_10, Index=0, Wrap=True)
number_slider_12 = Slider(1, range=0..1)
item_12 = ListItem(List=debrep_5.Edges, Index=0, Wrap=True)  # -> flatten(Item), flatten(Item1)
debrep_6 = DeconstructBrep(Brep=item_11)  # -> Faces, Edges, Vertices
item_13 = ListItem(List=debrep_6.Edges, Index=0, Wrap=True)  # -> Item, Item1
multiplication_3 = Multiplication(A=Slider(0.05, range=0..0.1), B=Slider(2, range=0..10))
pl_3 = ConstructPlane(Origin=area_4.Centroid, XAxis=item_12.Item, YAxis=item_12.Item1)
len_5 = Length(Curve=item_13.Item1)
len_6 = Length(Curve=item_13.Item)
division_6 = Division(A=multiplication_3, B=len_6)
division_7 = Division(A=multiplication_3, B=len_5)
subtraction_5 = Subtraction(A=number_slider_12, B=division_6)
subtraction_6 = Subtraction(A=number_slider_12, B=division_7)
scale_nu_3 = ScaleNU(Geometry=srf_10, Plane=pl_3, ScaleX=subtraction_5, ScaleY=subtraction_6, ScaleZ=1)  # -> Geometry, Transform

subfacesubset = HBSubfaceSubset(window=item_4)  # -> subface_set; plug-in component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

climatezones = HBClimateZones({"1 - Very Hot": "1", "2 - Hot": "2", "3 - Warm": "3", "4 - Mixed": "4", "5 - Cool": "5", "6 - Cold": "6", "7 - Very Cold": "7", "8 - Subarctic": "8"}, selected="5 - Cool")
bldgvintages = HBBuildingVintages({"ASHRAE 90.1 2019  |  IECC 2021": "2019", "ASHRAE 90.1 2016  |  IECC 2018": "2016", "ASHRAE 90.1 2013  |  IECC 2015": "2013", "ASHRAE 90.1 2010  |  IECC 2012": "2010", "ASHRAE 90.1 2007  |  IECC 2009": "2007", "ASHRAE 90.1 2004  |  IECC 2006": "2004", "1980-2004 (CBECS)": "1980_2004", "Pre-1980 (CBECS)": "pre_1980"}, selected="ASHRAE 90.1 2019  |  IECC 2021")
constructiontypes = HBConstructionTypes({"SteelFramed", "WoodFramed", "Mass", "Metal Building"}, selected="Mass")
constrsetclimate = HBConstructionSetByClimate(climate_zone=climatezones, vintage=bldgvintages, constr_type=constructiontypes)  # -> constr_set; plug-in component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
constructionset = HBConstructionSet(name="Custom Construction", base_constr_set=constrsetclimate, subface_subset=subfacesubset)  # -> constr_set; plug-in component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

path = FilePath("C:\Users\prana\OneDrive - Delft University of Technology\Thesis\02_Working\epw\NLD_Amsterdam.062400_IWEC\NLD_Amsterdam.062400_IWEC.epw")
path_2 = FilePath("C:\Users\prana\OneDrive - Delft University of Technology\Thesis\02_Working\epw\NLD_Amsterdam.062400_IWEC\NLD_Amsterdam.062400_IWEC.ddy")
climate = Panel(path)
climate_2 = Panel(path_2)
item_14 = ListItem(List=climate, Index=0, Wrap=True)
item_15 = ListItem(List=climate_2, Index=0, Wrap=True)
importepw = LBImportEPW(epw_file=item_14)  # -> location, dry_bulb_temperature, dew_point_temperature, relative_humidity, wind_speed, wind_direction, direct_normal_rad, diffuse_horizontal_rad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; plug-in component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
sizingpar = HBSizingParameter(ddy_file=item_15)  # -> sizing; plug-in component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

lighting = HBLighting(name="Watts_room1", watts_per_area=Slider(5, range=0..10), schedule=weeklyschedule.schedule)  # -> lighting; plug-in component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
people = HBPeople(name="People_room1", ppl_per_area=Slider(0.025, range=0..1), occupancy_sch=weeklyschedule.schedule)  # -> people; plug-in component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
equipment = HBEquipment(name="Equipment_room1", watts_per_area=Slider(5, range=0..10), schedule=weeklyschedule.schedule)  # -> equip; plug-in component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

ventilation = HBVentilation(name="Ventilation", ach=Slider(0.063, range=0..1), schedule=weeklyschedule.schedule)  # -> vent; plug-in component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
infiltration = HBInfiltration(name="Infiltration", flow_per_ext_area=Slider(0.0003, range=0..1))  # -> infil; plug-in component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

bldgprograms = HBBuildingPrograms({"LargeOffice", "MediumOffice", "SmallOffice", "MidriseApartment", "HighriseApartment", "Retail", "StripMall", "PrimarySchool", "SecondarySchool", "SmallHotel", "LargeHotel", "Hospital", "Outpatient", "Laboratory", "Warehouse", "SuperMarket", "FullServiceRestaurant", "QuickServiceRestaurant", "Courthouse", "LargeDataCenterHighITE", "LargeDataCenterLowITE", "SmallDataCenterHighITE", "SmallDataCenterLowITE"}, selected="LargeOffice")
searchprog = HBSearchPrograms(bldg_prog=bldgprograms)  # -> room_prog; plug-in component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
item_16 = ListItem(List=searchprog, Index=Slider(17, range=0..23), Wrap=True)
data = Data(item_16)
programtype = HBProgramType(
    name="Office1",
    base_program=data,
    people=people,
    lighting=lighting,
    electric_equip=equipment,
    infiltration=infiltration,
    ventilation=ventilation,
    setpoint=setpoint)  # -> program; plug-in component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

face = HBFace(geo=extr_3, type="Wall", bc="Outdoors")  # -> report, faces; plug-in component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
face_2 = HBFace(geo=boundary, type="Floor", bc="Outdoors")  # -> report, faces; plug-in component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
face_3 = HBFace(geo=move.Geometry, type="RoofCeiling", bc="Outdoors")  # -> report, faces; plug-in component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
aperture = HBAperture(geo=scale_nu.Geometry)  # -> report, apertures; plug-in component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
aperture_2 = HBAperture(geo=scale_nu_2.Geometry)  # -> report, apertures; plug-in component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
face_4 = HBFace(geo=srf_2, type="Wall", bc="Outdoors")  # -> report, faces; plug-in component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
face_5 = HBFace(geo=srf_4, type="Wall", bc="Outdoors")  # -> report, faces; plug-in component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
aperture_3 = HBAperture(geo=scale_nu_3.Geometry)  # -> report, apertures; plug-in component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
face_6 = HBFace(geo=srf_3, type="Wall", bc="Outdoors")  # -> report, faces; plug-in component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
face_7 = HBFace(geo=srf, type="Wall", bc="Outdoors")  # -> report, faces; plug-in component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
addsubface = HBAddSubface(hb_obj=flatten(face_4.faces), sub_faces=flatten(aperture.apertures))  # -> hb_obj; plug-in component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
addsubface_2 = HBAddSubface(hb_obj=flatten(face_5.faces), sub_faces=flatten(aperture_2.apertures))  # -> hb_obj; plug-in component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
addsubface_3 = HBAddSubface(hb_obj=flatten(face_6.faces), sub_faces=flatten(aperture_3.apertures))  # -> hb_obj; plug-in component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
merge_2 = Merge(Data1=face_2.faces, Data2=face_3.faces, Data3=addsubface, Data4=addsubface_2, Data5=addsubface_3, Data6=face_7.faces)
room = HBRoom(faces=flatten(merge_2), constr_set=constructionset, program=programtype, conditioned=True)  # -> report, room; plug-in component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
model = HBModel(rooms=flatten(room.room), faces=flatten(face.faces))  # -> report, model; plug-in component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
gridrooms = HBSensorGridFromRooms(rooms=room.room, grid_size=Slider(0.451, range=0..1))  # -> grid, points, mesh; plug-in component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

simpar = HBSimulationParameter(timestep=6, sizing=sizingpar)  # -> sim_par; plug-in component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
toggle = BooleanToggle(False)
data_2 = Data(item_14)
modeltoosm = HBModelToOSM(model=model.model, epw_file=data_2, sim_par=simpar, write=toggle, run=toggle)  # -> report, jsons, osw, osm, idf, sql, zsz, rdd, html; plug-in component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

assigngridsviews = HBAssignGridsAndViews(model=model.model, grids=flatten(gridrooms.grid))  # -> model; plug-in component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
data_3 = Data(weeklyschedule.schedule)
data_4 = Data(item_14)
annualglare = HBImagelessAnnualGlare(model=assigngridsviews, wea=data_4, schedule=weeklyschedule.schedule, run=Toggle(False))  # -> report, results, GA; plug-in component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
annualdaylight = HBAnnualDaylight(model=assigngridsviews, wea=data_4, schedule=data_3, run=Toggle(False))  # -> report, results, DA, cDA, UDI, UDI_low, UDI_up; plug-in component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

eui = HBEndUseIntensity(sql=modeltoosm.sql)  # -> eui, eui_end_use, end_uses, gross_floor; plug-in component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

heatmap = LBSpatialHeatmap(values=annualdaylight.DA, mesh=gridrooms.mesh, legend_title="%", global_title="Daylight Autonomy")  # -> mesh, legend, title, colors, legend_par, vis_set; plug-in component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

heatmap_2 = LBSpatialHeatmap(values=annualglare.GA, mesh=gridrooms.mesh, legend_title="%", global_title="Glare Autonomy")  # -> mesh, legend, title, colors, legend_par, vis_set; plug-in component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

# ==== cluster Cluster
blindmat = HBBlindMaterial(
    name="VB_25_L",
    slat_width="0.025",
    slat_separation="0.025",
    slat_thickness="0.001",
    slat_angle="45",
    transmittance="0",
    reflectance="0.75",
    dist_to_glass="0.05")  # -> mat; plug-in component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
blindmat_2 = HBBlindMaterial(
    name="VB_25_M",
    slat_width="0.025",
    slat_separation="0.025",
    slat_thickness="0.001",
    slat_angle="45",
    transmittance="0",
    reflectance="0.37",
    dist_to_glass="0.05")  # -> mat; plug-in component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
blindmat_3 = HBBlindMaterial(
    name="VB_25_D",
    slat_width="0.025",
    slat_separation="0.025",
    slat_thickness="0.001",
    slat_angle="45",
    transmittance="0",
    reflectance="0.04",
    dist_to_glass="0.05")  # -> mat; plug-in component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
blindmat_4 = HBBlindMaterial(
    name="VB_50_L",
    slat_width="0.05",
    slat_separation="0.05",
    slat_thickness="0.001",
    slat_angle="45",
    transmittance="0",
    reflectance="0.75",
    dist_to_glass="0.05")  # -> mat; plug-in component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
blindmat_5 = HBBlindMaterial(
    name="VB_50_M",
    slat_width="0.05",
    slat_separation="0.05",
    slat_thickness="0.001",
    slat_angle="45",
    transmittance="0",
    reflectance="0.37",
    dist_to_glass="0.05")  # -> mat; plug-in component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
blindmat_6 = HBBlindMaterial(
    name="VB_50_M",
    slat_width="0.05",
    slat_separation="0.05",
    slat_thickness="0.001",
    slat_angle="45",
    transmittance="0",
    reflectance="0.04",
    dist_to_glass="0.05")  # -> mat; plug-in component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
shademat = HBShadeMaterial(name="RB_5_L", thickness="2.5", transmittance="0.25", reflectance="0.55", dist_to_glass="0.05", permeability="0.05")  # -> mat; plug-in component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
shademat_2 = HBShadeMaterial(name="RB_5_M", thickness="2.5", transmittance="0.11", reflectance="0.28", dist_to_glass="0.05", permeability="0.05")  # -> mat; plug-in component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
shademat_3 = HBShadeMaterial(name="RB_5_D", thickness="2.5", transmittance="0.05", reflectance="0.06", dist_to_glass="0.05", permeability="0.05")  # -> mat; plug-in component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
shademat_4 = HBShadeMaterial(name="RB_10_L", thickness="2.5", transmittance="0.25", reflectance="0.55", dist_to_glass="0.05", permeability="0.1")  # -> mat; plug-in component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
shademat_5 = HBShadeMaterial(name="RB_10_M", thickness="2.5", transmittance="0.11", reflectance="0.28", dist_to_glass="0.05", permeability="0.1")  # -> mat; plug-in component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
shademat_6 = HBShadeMaterial(name="RB_10_D", thickness="2.5", transmittance="0.05", reflectance="0.06", dist_to_glass="0.05", permeability="0.1")  # -> mat; plug-in component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
mat = ClusterOutput(shademat)
mat_2 = ClusterOutput(shademat_2)
mat_3 = ClusterOutput(shademat_3)
mat_4 = ClusterOutput(shademat_4)
mat_5 = ClusterOutput(shademat_5)
mat_6 = ClusterOutput(shademat_6)
mat_7 = ClusterOutput(blindmat)
mat_8 = ClusterOutput(blindmat_2)
mat_9 = ClusterOutput(blindmat_3)
mat_10 = ClusterOutput(blindmat_4)
mat_11 = ClusterOutput(blindmat_5)
mat_12 = ClusterOutput(blindmat_6)
